# Grasshopper definition rnd_node_color.gh (Grasshopper 1.0.7)
# plug-ins: Kangaroo2 Components

radius = Slider(12, range=5..20)
count = Slider(12, range=2..20)
radius_2 = GetNumber(radius, AtLeast=1, AtMost=1, Maximum=1.797693135e+308, Minimum=-1.797693135e+308, TreeAccess=False)
count_2 = GetNumber(count, AtLeast=1, AtMost=1, Maximum=1.797693135e+308, Minimum=-1.797693135e+308, TreeAccess=False)
sph = Sphere(Base=PlaneXY(0, 0, 0), Radius=radius_2)
pt = ConstructPoint(XCoordinate=0, YCoordinate=0, ZCoordinate=0)
popgeo = PopulateGeometry(Geometry=sph, Count=count_2, Seed=1)
division = Division(A=radius_2, B=count_2)
ln = Line(StartPoint=pt, EndPoint=popgeo)
mp = MultiPipe(Curves=ln, NodeSize=division, EndOffset=1, StrutSize=1, Segment=0, KinkAngle=0.6, CubeFit=0)
meshsubd = MeshFromSubD(SubD=mp, Density=2)
clean = CombineClean(Meshes=meshsubd)
medges = MeshEdges(Mesh=clean)  # -> NakedEdges, InteriorEdges, NonManifoldEdges
join = JoinCurves(Curves=medges.NakedEdges, Preserve=False)
join_2 = JoinCurves(Curves=medges.InteriorEdges, Preserve=False)
mesh = Mesh(clean)
pt_2 = ConstructPoint(XCoordinate=0, YCoordinate=0, ZCoordinate=0)
# curves need a property
merge = Merge(Data1=join, Data2=join_2)  # -> flatten(Result)
curvepoint = PointOnCurve(merge, parameter=0.5)
pull = PullPoint(Point=curvepoint, Geometry=pt_2, ClosestOnly=True)  # -> ClosestPoint, Distance
bnd = Bounds(Numbers=pull.Distance)
remap = RemapNumbers(Value=pull.Distance, Source=bnd, Target=Domain(0, 1))  # -> Mapped, Clipped
gradient = Gradient(LowerLimit=0, UpperLimit=1, Parameter=remap.Mapped, stops=[0: RGB(0, 128, 0), 0.5: RGB(255, 255, 0), 1: RGB(255, 0, 0)])
# meshes have color!
demesh = DeconstructMesh(Mesh=mesh)  # -> Vertices, Faces, Colours, Normals
# transparency doesnt transfer
swatch = ColourSwatch(SwatchColor=RGBA(194, 45, 45, 0))
conmesh = ConstructMesh(Vertices=demesh.Vertices, Faces=demesh.Faces, Colours=swatch)
clean_2 = CombineClean(Meshes=conmesh)

# ---- group: must be a string
userkey = Text("color")
uservalue = Text(gradient)

# ----
context_bake = ContextBake(Geometry=clean_2)
# add color
c_script = CSharpScript(geometry=merge, userKey=userkey, userValue=uservalue)  # -> out, geoWithUserString; inputs geometry: GeometryBase, userKey: String, userValue: String
# ---------- c_script: C# ----------
    geometry.SetUserString(userKey, userValue);
   geoWithUserString = geometry;
# ---------- end c_script ----------
lng = ListLength(List=gradient)
random = Random(Range=Domain(0, 1), Number=lng, Seed=2)
userkey_2 = Text("price")
uservalue_2 = Text(random)
# add price
c_script_2 = CSharpScript(geometry=c_script.geoWithUserString, userKey=userkey_2, userValue=uservalue_2)  # -> out, geoWithUserString; inputs geometry: GeometryBase, userKey: String, userValue: String; same code as c_script
curve = Curve(flatten(c_script_2.geoWithUserString))
context_bake_2 = ContextBake(Geometry=curve)
