# Grasshopper definition PROTO_4_V4.gh (Grasshopper 1.0.7)

count = Slider(12, range=0..16)
radius = Slider(5, range=0..10)
count_2 = Slider(3, range=2..10)
count_3 = Slider(12, range=2..20)
ipe = GetInteger(count, AtLeast=1, AtMost=1, Maximum=2147483647, Minimum=-2147483648, TreeAccess=False)
radius_2 = GetNumber(radius, AtLeast=1, AtMost=1, Maximum=1.797693135e+308, Minimum=-1.797693135e+308, TreeAccess=False)
ucount = GetNumber(count_2, AtLeast=1, AtMost=1, Maximum=1.797693135e+308, Minimum=-1.797693135e+308, TreeAccess=False)
vcount = GetNumber(count_3, AtLeast=1, AtMost=1, Maximum=1.797693135e+308, Minimum=-1.797693135e+308, TreeAccess=False)
r¹ = Rail1(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)
r² = Rail2(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)
S = Sections(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)
ipe_2 = IPE(select=ipe)
swp2 = Sweep2(Rail1=r¹, Rail2=r², Sections=S, SameHeight=False)
srf = Surface(swp2)
U = UCount(ucount)
V = VCount(vcount)
offset = Offset(Surface=srf, Distance=radius_2, Retrim=True)
sframes = SurfaceFrames(Surface=srf, UCount=U, VCount=V)  # -> Frames, Parameters
panel = Panel("""True
False""")
sframes_2 = SurfaceFrames(Surface=offset, UCount=U, VCount=V)  # -> Frames, Parameters
pln = Plane(sframes.Frames)
pln_2 = Plane(sframes_2.Frames)

cull = CullPattern(List=pln_2, CullPattern=invert(panel))
cull_2 = CullPattern(List=pln, CullPattern=invert(panel))

flip = FlipMatrix(Data=cull_2)
flip_2 = FlipMatrix(Data=cull)

panel_2 = Panel("""True
False""")
panel_3 = Panel("""0
1""")

pln_3 = Plane(flip_2)
pln_4 = Plane(flip)

panel_4 = Panel("""False
True""")
panel_5 = Panel("""1
0""")

cull_3 = CullPattern(List=pln_2, CullPattern=invert(panel_2))
cull_4 = CullPattern(List=pln, CullPattern=panel_2)
cull_5 = CullPattern(List=pln_3, CullPattern=invert(panel_4))
cull_6 = CullPattern(List=pln_4, CullPattern=panel_4)
weave = Weave(Pattern=panel_3, Stream0=cull_4, Stream1=cull_3, NullGaps=False)
weave_2 = Weave(Pattern=panel_5, Stream0=cull_6, Stream1=cull_5, NullGaps=False)
pline = PolyLine(Vertices=cull_4, Closed=False)
pline_2 = PolyLine(Vertices=weave, Closed=False)
pline_3 = PolyLine(Vertices=cull_3, Closed=False)
pline_4 = PolyLine(Vertices=cull_6, Closed=False)
pline_5 = PolyLine(Vertices=weave_2, Closed=False)
neg = Negative(Value=Slider(0.146, range=0..1))
pline_6 = PolyLine(Vertices=cull_5, Closed=False)
explode = Explode(Curve=pline_2, Recursive=True)  # -> Segments, Vertices
explode_2 = Explode(Curve=pline_5, Recursive=True)  # -> Segments, Vertices
ext = ExtendCurve(Curve=explode_2.Segments, Type=0, Start=neg, End=neg)
crv_p1 = Curve(simplify(pline))
crv_d = Curve(simplify(explode.Segments))
crv_p2 = Curve(simplify(pline_3))
crv_p1_2 = Curve(simplify(pline_4))
crv_d_2 = Curve(simplify(ext))
crv_p2_2 = Curve(simplify(pline_6))
entwine = Entwine(Branch00=crv_p1, Branch01=crv_d, Branch02=crv_p2, FlattenInputs=True)
entwine_2 = Entwine(Branch00=crv_p1_2, Branch01=crv_d_2, Branch02=crv_p2_2, FlattenInputs=True)
entwine_3 = Entwine(Branch00=entwine, Branch01=entwine_2, FlattenInputs=True)
geo = Geometry(entwine_3)
crvsect = Curve(ipe_2)
xy = XYPlane(Origin=Point(0, 0, 0))
crv_rail = Curve(graft(geo))

crvsect_2 = Curve(crvsect)
pt = Point(xy)

pframe = PerpFrame(Curve=reparameterize(crv_rail), Parameter="0")
prot = RotatePlane(Plane=pframe, Angle=degrees(Slider(0, range=0..360)))
orient = Orient(Geometry=crvsect_2, Source=pt, Target=prot)  # -> Geometry, Transform
swp1 = Sweep1(Rail=crv_rail, Sections=orient.Geometry, Miter=1)
settings_speed = SettingsSpeed()
mesh_brep = MeshBrep(Brep=swp1, Settings=settings_speed)
panel_6 = Panel("""IPE80  = 0
IPE100 = 1
IPE120 = 2
IPE140 = 3
IPE160 = 4
IPE180 = 5
IPE200 = 6
IPE220 = 7
IPE240 = 8
IPE270 = 9
IPE300 = 10
IPE330 = 11
IPE360 = 12
IPE400 = 13
IPE450 = 14
IPE500 = 15
IPE550 = 16""")
list_item = ListItem(List=panel_6, Index=count, Wrap=True)
brep_edges = BrepEdges(Brep=swp1)  # -> Naked, Interior, NonManifold
split_tree = SplitTree(Data=simplify(mesh_brep), Masks=flatten("{0;*}"))  # -> Positive, Negative
curve = Curve(flatten(brep_edges.Interior))
longest_list = LongestList(ListA=ColourSwatch(SwatchColor=RGB(224, 22, 22)), ListB=flatten(split_tree.Positive), PaddingMode=2)  # -> ListA, ListB
longest_list_2 = LongestList(ListListA=ColourSwatch(SwatchColor=RGB(83, 91, 212)), ListListB=flatten(split_tree.Negative), PaddingMode=2)  # -> ListListA, ListListB
txt = Text(longest_list_2.ListListA)
txt_2 = Text(longest_list.ListA)
merge = Merge(Data1=txt_2, Data2=txt)
merge_2 = Merge(Data1=longest_list.ListB, Data2=longest_list_2.ListListB)
userkey = Text("color")
c_script = CSharpScript(geometry=merge_2, userKey=userkey, userValue=merge)  # -> out, geoWithUserString; inputs geometry: GeometryBase, userKey: String, userValue: String
# ---------- c_script: C# ----------
    geometry.SetUserString(userKey, userValue);
   geoWithUserString = geometry;
# ---------- end c_script ----------
unit_x = UnitX(Factor=1)
mesh = Mesh(c_script.geoWithUserString)
rotate_3d = Rotate3D(Geometry=mesh, Angle=1.570796327, Center=Point(0, 0, 0), Axis=unit_x)  # -> Geometry, Transform
transform = Transform(Geometry=curve, Transform=rotate_3d.Transform)
rotate_3d_2 = Rotate3D(Geometry=rotate_3d.Geometry, Angle=3.141592654, Center=Point(0, 0, 0), Axis=unit_x)  # -> Geometry, Transform
unit_y = UnitY(Factor=1)
transform_2 = Transform(Geometry=transform, Transform=rotate_3d_2.Transform)
rotate_3d_3 = Rotate3D(Geometry=rotate_3d_2.Geometry, Angle=1.570796327, Center=Point(0, 0, 0), Axis=unit_y)  # -> Geometry, Transform
transform_3 = Transform(Geometry=transform_2, Transform=rotate_3d_3.Transform)
context_bake = ContextBake(Geometry=rotate_3d_3.Geometry)
context_bake_2 = ContextBake(Geometry=transform_3)

# ==== cluster IPE: IPE
list = ValueList({"IPE80": 0, "IPE100": 1, "IPE120": 2, "IPE140": 3, "IPE160": 4, "IPE180": 5, "IPE200": 6, "IPE220": 7, "IPE240": 8, "IPE270": 9, "IPE300": 10, "IPE330": 11, "IPE360": 12, "IPE400": 13, "IPE450": 14, "IPE500": 15, "IPE550": 16}, selected="IPE80")
select = ClusterInput()
select_2 = Number(select)

ipe_section = Curve([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])
perfiles_ipe = Text(Tree({0}: ["IPE", "80", "80", "46", "3,8", "5,2", "5", "60", "328", "7,64", "11,6", "80,1", "20,0", "3,24", "8,49", "3,69", "1,05", "0,721", "118", "-", "-", "3,8", "6,00"], {1}: ["IPE", "100", "100", "55", "4,1", "5,7", "7", "75", "400", "10,3", "19,7", "171", "34,2", "4,07", "15,9", "5,79", "1,24", "1,140", "351", "-", "-", "4,1", "8,10"], {2}: ["IPE", "120", "120", "64", "4,4", "6,3", "7", "93", "475", "13,2", "30,4", "318", "53,0", "4,90", "27,7", "8,65", "1,45", "1,770", "890", "35", "-", "4,4", "10,4"], {3}: ["IPE", "140", "140", "73", "4,7", "6,9", "7", "112", "551", "16,4", "44,2", "541", "77,3", "5,74", "44,9", "12,3", "1,65", "2,630", "1981", "40", "11", "4,7", "12,9"], {4}: ["IPE", "160", "160", "82", "5,0", "7,4", "9", "127", "623", "20,1", "61,9", "869", "109", "6,58", "68,3", "16,7", "1,84", "3,640", "3959", "44", "13", "5", "15,8"], {5}: ["IPE", "180", "180", "91", "5,3", "8,0", "9", "146", "698", "23,9", "83,2", "1320", "146", "7,42", "101", "22,2", "2,05", "5,060", "7431", "48", "13", "5,3", "18,8"]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))

item = ListItem(List=perfiles_ipe, Index=0, Wrap=True)  # -> Item, Item1, Item2, Item3, Item4, Item5, Item6, Item7, Item8, Item9
nomperfil = Text(simplify(flatten(["IPE80", "IPE100", "IPE120", "IPE140", "IPE160", "IPE180", "IPE200", "IPE220", "IPE240", "IPE270", "IPE300", "IPE330", "IPE360", "IPE400", "IPE450", "IPE500", "IPE550"])))
área_cm² = Text(simplify(flatten(item.Item9)))
h = Text(simplify(flatten(item.Item2)))
b = Text(simplify(flatten(item.Item3)))
e = Text(simplify(flatten(item.Item4)))
h1 = Text(simplify(flatten(item.Item7)))
u = Text(simplify(flatten(item.Item8)))
e1 = Text(simplify(flatten(item.Item5)))
r1 = Text(simplify(flatten(item.Item6)))
item_2 = ListItem(List=nomperfil, Index=select_2, Wrap=True)
item_3 = ListItem(List=h, Index=select_2, Wrap=True)
item_4 = ListItem(List=b, Index=select_2, Wrap=True)
item_5 = ListItem(List=e, Index=select_2, Wrap=True)
item_6 = ListItem(List=e1, Index=select_2, Wrap=True)
item_7 = ListItem(List=r1, Index=select_2, Wrap=True)
item_8 = ListItem(List=h1, Index=select_2, Wrap=True)
item_9 = ListItem(List=área_cm², Index=select_2, Wrap=True)
item_10 = ListItem(List=u, Index=select_2, Wrap=True)
item_11 = ListItem(List=ipe_section, Index=select_2, Wrap=True)
crv = Curve(item_11)
crv_2 = ClusterOutput(crv)
